# Dynamo graph WD_XUAT CAD VA PDF_script.dyn "WD_XUAT CAD VA PDF2" (Dynamo 3.3.0.6316)
# author: Tai Em
# Done

python_script = Python()  # CPython3; unwired: IN[0]
# ---------- python_script.python (405 lines) ----------
import sys
import os
import json
import clr

# 1. Nạp các thư viện Revit API & Windows Forms
clr.AddReference('RevitAPI')
from Autodesk.Revit.DB import *

clr.AddReference('RevitServices')
from RevitServices.Persistence import DocumentManager
from RevitServices.Transactions import TransactionManager

clr.AddReference('System.Windows.Forms')
clr.AddReference('System.Drawing')
import System
from System.Windows.Forms import (
    Form, Label, TextBox, Button, ComboBox, CheckBox, RadioButton,
    FolderBrowserDialog, DialogResult, FormStartPosition, FormBorderStyle,
    AutoScaleMode, ComboBoxStyle
)
from System.Drawing import Size, Point, Font, FontStyle, Color, ContentAlignment

doc = DocumentManager.Instance.CurrentDBDocument

# Quản lý cấu hình lưu trữ
CONFIG_PATH = os.path.join(os.environ.get('TEMP', 'C:\\Temp'), 'multi_exporter_config.json')

def load_config():
    default_config = {
        "cad_prefix": "DUAN",
        "pdf_name": "BAN_VE_PDF",
        "cad_path": "C:\\ExportCAD",
        "pdf_path": "C:\\ExportPDF",
        "export_cad": True,
        "export_pdf": True,
        "combine_pdf": True
    }
    if os.path.exists(CONFIG_PATH):
        try:
            with open(CONFIG_PATH, 'r') as f:
                data = json.load(f)
                default_config.update(data)
        except:
            pass
    return default_config

def save_config(cad_prefix, pdf_name, cad_path, pdf_path, cad, pdf, combine):
    try:
        with open(CONFIG_PATH, 'w') as f:
            json.dump({
                "cad_prefix": cad_prefix,
                "pdf_name": pdf_name,
                "cad_path": cad_path,
                "pdf_path": pdf_path,
                "export_cad": cad,
                "export_pdf": pdf,
                "combine_pdf": combine
            }, f)
    except:
        pass

# Thu thập dữ liệu từ Revit project
try:
    collections = FilteredElementCollector(doc).OfCategory(BuiltInCategory.OST_SheetCollections).WhereElementIsNotElementType().ToElements()
    col_dict = {c.Name: c for c in collections} if collections else {}
except:
    col_dict = {}

sheet_sets = FilteredElementCollector(doc).OfClass(ViewSheetSet).ToElements()
set_dict = {s.Name: s for s in sheet_sets} if sheet_sets else {}

dwg_setups = FilteredElementCollector(doc).OfClass(ExportDWGSettings).ToElements()
dwg_setup_dict = {s.Name: s for s in dwg_setups} if dwg_setups else {}

try:
    pdf_setups = FilteredElementCollector(doc).OfClass(ExportPDFSettings).ToElements()
    pdf_setup_dict = {s.Name: s for s in pdf_setups} if pdf_setups else {}
except:
    pdf_setup_dict = {}

# 2. Xây dựng Form UI (Đã sửa kế thừa để tương thích CPython3 / IronPython)
class CustomExportForm(Form):
    def __init__(self):
        super(CustomExportForm, self).__init__() # Sửa khởi tạo tương thích đa nền tảng
        saved_config = load_config()

        self.Text = "Sheet Collection & Sets (CAD & PDF)"
        self.ClientSize = Size(660, 660)
        self.StartPosition = FormStartPosition.CenterScreen
        self.FormBorderStyle = FormBorderStyle.FixedDialog
        self.MaximizeBox = False
        self.MinimizeBox = False
        self.AutoScaleMode = AutoScaleMode.Dpi
        self.Font = Font("Segoe UI", 9.5)

        # 1. Chế độ lọc bản vẽ
        lbl_mode = Label()
        lbl_mode.Text = "Chế độ lọc bản vẽ:"
        lbl_mode.Location = Point(20, 20)
        lbl_mode.Size = Size(130, 22)

        self.rb_col = RadioButton()
        self.rb_col.Text = "Sheet Collection"
        self.rb_col.Location = Point(155, 18)
        self.rb_col.Size = Size(150, 24)
        self.rb_col.Checked = True
        self.rb_col.CheckedChanged += self.toggle_mode

        self.rb_set = RadioButton()
        self.rb_set.Text = "Sheet Set"
        self.rb_set.Location = Point(315, 18)
        self.rb_set.Size = Size(120, 24)

        # 2. Chọn Định Dạng Xuất
        lbl_fmt = Label()
        lbl_fmt.Text = "Định dạng xuất:"
        lbl_fmt.Location = Point(20, 55)
        lbl_fmt.Size = Size(120, 22)

        self.chk_cad = CheckBox()
        self.chk_cad.Text = "Xuất CAD (.dwg)"
        self.chk_cad.Location = Point(155, 53)
        self.chk_cad.Size = Size(145, 24)
        self.chk_cad.Checked = saved_config.get("export_cad", True)

        self.chk_pdf = CheckBox()
        self.chk_pdf.Text = "Xuất PDF (.pdf)"
        self.chk_pdf.Location = Point(305, 53)
        self.chk_pdf.Size = Size(140, 24)
        self.chk_pdf.Checked = saved_config.get("export_pdf", True)

        self.chk_combine = CheckBox()
        self.chk_combine.Text = "Gộp chung 1 file PDF"
        self.chk_combine.Location = Point(450, 53)
        self.chk_combine.Size = Size(190, 24)
        self.chk_combine.Checked = saved_config.get("combine_pdf", True)

        # 3. Chọn Collection / Set
        self.lbl_target = Label()
        self.lbl_target.Text = "1. Chọn Sheet Collection:"
        self.lbl_target.Location = Point(20, 95)
        self.lbl_target.Size = Size(620, 20)

        self.cb_target = ComboBox()
        self.cb_target.Location = Point(20, 120)
        self.cb_target.Size = Size(620, 25)
        self.cb_target.DropDownStyle = ComboBoxStyle.DropDownList

        # 4. Tách DWG Setup & PDF Setup
        lbl_dwg_setup = Label()
        lbl_dwg_setup.Text = "2. Chọn DWG Export Setup:"
        lbl_dwg_setup.Location = Point(20, 160)
        lbl_dwg_setup.Size = Size(300, 20)

        self.cb_dwg_setup = ComboBox()
        self.cb_dwg_setup.Location = Point(20, 185)
        self.cb_dwg_setup.Size = Size(300, 25)
        self.cb_dwg_setup.DropDownStyle = ComboBoxStyle.DropDownList
        for k in dwg_setup_dict.keys(): 
            self.cb_dwg_setup.Items.Add(k)
        if dwg_setup_dict: 
            self.cb_dwg_setup.SelectedIndex = 0

        lbl_pdf_setup = Label()
        lbl_pdf_setup.Text = "3. Chọn PDF Export Setup:"
        lbl_pdf_setup.Location = Point(340, 160)
        lbl_pdf_setup.Size = Size(300, 20)

        self.cb_pdf_setup = ComboBox()
        self.cb_pdf_setup.Location = Point(340, 185)
        self.cb_pdf_setup.Size = Size(300, 25)
        self.cb_pdf_setup.DropDownStyle = ComboBoxStyle.DropDownList
        self.cb_pdf_setup.Items.Add("<in-session>")
        for k in pdf_setup_dict.keys(): 
            self.cb_pdf_setup.Items.Add(k)
        self.cb_pdf_setup.SelectedIndex = 0

        # 5. Tên / Tiền tố riêng cho CAD & PDF
        lbl_cad_prefix = Label()
        lbl_cad_prefix.Text = "4. Tiền tố file CAD (<Tự điền>-SheetNumber-SheetName):"
        lbl_cad_prefix.Location = Point(20, 230)
        lbl_cad_prefix.Size = Size(620, 20)

        self.txt_cad_prefix = TextBox()
        self.txt_cad_prefix.Location = Point(20, 255)
        self.txt_cad_prefix.Size = Size(620, 25)
        self.txt_cad_prefix.Text = saved_config.get("cad_prefix", "DUAN")

        lbl_pdf_name = Label()
        lbl_pdf_name.Text = "5. Tên file PDF (Tên file gộp HOẶC Tiền tố khi tách trang):"
        lbl_pdf_name.Location = Point(20, 295)
        lbl_pdf_name.Size = Size(620, 20)

        self.txt_pdf_name = TextBox()
        self.txt_pdf_name.Location = Point(20, 320)
        self.txt_pdf_name.Size = Size(620, 25)
        self.txt_pdf_name.Text = saved_config.get("pdf_name", "TSG-WON")

        # 6. Thư mục lưu CAD
        lbl_cad_path = Label()
        lbl_cad_path.Text = "6. Thư mục lưu file CAD:"
        lbl_cad_path.Location = Point(20, 360)
        lbl_cad_path.Size = Size(620, 20)

        self.txt_cad_path = TextBox()
        self.txt_cad_path.Location = Point(20, 385)
        self.txt_cad_path.Size = Size(500, 25)
        self.txt_cad_path.Text = saved_config.get("cad_path", "C:\\ExportCAD")

        btn_browse_cad = Button()
        btn_browse_cad.Text = "Browse..."
        btn_browse_cad.Location = Point(535, 384)
        btn_browse_cad.Size = Size(105, 27)
        btn_browse_cad.Click += self.browse_cad_folder

        # 7. Thư mục lưu PDF
        lbl_pdf_path = Label()
        lbl_pdf_path.Text = "7. Thư mục lưu file PDF:"
        lbl_pdf_path.Location = Point(20, 425)
        lbl_pdf_path.Size = Size(620, 20)

        self.txt_pdf_path = TextBox()
        self.txt_pdf_path.Location = Point(20, 450)
        self.txt_pdf_path.Size = Size(500, 25)
        self.txt_pdf_path.Text = saved_config.get("pdf_path", "C:\\ExportPDF")

        btn_browse_pdf = Button()
        btn_browse_pdf.Text = "Browse..."
        btn_browse_pdf.Location = Point(535, 449)
        btn_browse_pdf.Size = Size(105, 27)
        btn_browse_pdf.Click += self.browse_pdf_folder

        # Nút Export
        btn_run = Button()
        btn_run.Text = "XUẤT BẢN VẼ (EXPORT)"
        btn_run.Location = Point(220, 535)
        btn_run.Size = Size(220, 45)
        btn_run.DialogResult = DialogResult.OK
        btn_run.BackColor = Color.LightSkyBlue

        # 8. Dòng Bản quyền
        lbl_author = Label()
        lbl_author.Text = "By: Nguyen Anh Tai"
        lbl_author.Font = Font("Segoe UI", 8.5, FontStyle.Italic)
        lbl_author.ForeColor = Color.DimGray
        lbl_author.Location = Point(500, 630)
        lbl_author.Size = Size(140, 20)
        lbl_author.TextAlign = ContentAlignment.MiddleRight

        # Controls Addition
        self.Controls.Add(lbl_mode)
        self.Controls.Add(self.rb_col)
        self.Controls.Add(self.rb_set)
        self.Controls.Add(lbl_fmt)
        self.Controls.Add(self.chk_cad)
        self.Controls.Add(self.chk_pdf)
        self.Controls.Add(self.chk_combine)
        self.Controls.Add(self.lbl_target)
        self.Controls.Add(self.cb_target)
        self.Controls.Add(lbl_dwg_setup)
        self.Controls.Add(self.cb_dwg_setup)
        self.Controls.Add(lbl_pdf_setup)
        self.Controls.Add(self.cb_pdf_setup)
        self.Controls.Add(lbl_cad_prefix)
        self.Controls.Add(self.txt_cad_prefix)
        self.Controls.Add(lbl_pdf_name)
        self.Controls.Add(self.txt_pdf_name)
        self.Controls.Add(lbl_cad_path)
        self.Controls.Add(self.txt_cad_path)
        self.Controls.Add(btn_browse_cad)
        self.Controls.Add(lbl_pdf_path)
        self.Controls.Add(self.txt_pdf_path)
        self.Controls.Add(btn_browse_pdf)
        self.Controls.Add(btn_run)
        self.Controls.Add(lbl_author)

        self.update_target_list()

    def toggle_mode(self, sender, args):
        self.update_target_list()

    def update_target_list(self):
        self.cb_target.Items.Clear()
        if self.rb_col.Checked:
            self.lbl_target.Text = "1. Chọn Sheet Collection:"
            for k in col_dict.keys(): 
                self.cb_target.Items.Add(k)
            if col_dict: 
                self.cb_target.SelectedIndex = 0
        else:
            self.lbl_target.Text = "1. Chọn Sheet Set sẵn có:"
            for k in set_dict.keys(): 
                self.cb_target.Items.Add(k)
            if set_dict: 
                self.cb_target.SelectedIndex = 0

    def browse_cad_folder(self, sender, args):
        dialog = FolderBrowserDialog()
        if dialog.ShowDialog() == DialogResult.OK:
            self.txt_cad_path.Text = dialog.SelectedPath

    def browse_pdf_folder(self, sender, args):
        dialog = FolderBrowserDialog()
        if dialog.ShowDialog() == DialogResult.OK:
            self.txt_pdf_path.Text = dialog.SelectedPath

# 3. Hiển thị Form và Xử lý Xuất file (Đã loại bỏ EnableVisualStyles để tránh crash)
form = CustomExportForm()

if form.ShowDialog() == DialogResult.OK:
    selected_target_name = form.cb_target.SelectedItem
    selected_dwg_setup_name = form.cb_dwg_setup.SelectedItem
    selected_pdf_setup_name = form.cb_pdf_setup.SelectedItem
    
    cad_prefix = form.txt_cad_prefix.Text
    pdf_name = form.txt_pdf_name.Text
    cad_folder_path = form.txt_cad_path.Text
    pdf_folder_path = form.txt_pdf_path.Text
    
    export_cad = form.chk_cad.Checked
    export_pdf = form.chk_pdf.Checked
    combine_pdf = form.chk_combine.Checked

    save_config(cad_prefix, pdf_name, cad_folder_path, pdf_folder_path, export_cad, export_pdf, combine_pdf)

    # Lọc danh sách Sheets
    matched_sheets = []
    if form.rb_col.Checked:
        target_col = col_dict.get(selected_target_name)
        if target_col:
            all_sheets = FilteredElementCollector(doc).OfClass(ViewSheet).ToElements()
            for s in all_sheets:
                p = s.get_Parameter(BuiltInParameter.SHEET_COLLECTION)
                if not p:
                    p = s.LookupParameter("Sheet Collection")
                if p and p.AsElementId() == target_col.Id:
                    matched_sheets.append(s)
    else:
        target_set = set_dict.get(selected_target_name)
        if target_set:
            for v in target_set.Views:
                if isinstance(v, ViewSheet):
                    matched_sheets.append(v)

    # Thiết lập CAD Options
    selected_dwg_setup = dwg_setup_dict.get(selected_dwg_setup_name)
    dwg_options = selected_dwg_setup.GetDWGExportOptions() if selected_dwg_setup else DWGExportOptions()
    dwg_options.MergedViews = True

    cad_count = 0
    pdf_count = 0

    TransactionManager.Instance.EnsureInTransaction(doc)

    # 1. XỬ LÝ XUẤT CAD
    if export_cad and matched_sheets:
        if not os.path.exists(cad_folder_path):
            os.makedirs(cad_folder_path)
            
        for sheet in matched_sheets:
            sheet_ids = System.Collections.Generic.List[ElementId]([sheet.Id])
            s_num = str(sheet.SheetNumber).replace("/", "-").replace("\\", "-")
            s_name = str(sheet.Name).replace("/", "-").replace("\\", "-")
            custom_filename = "{}-{}-{}".format(cad_prefix, s_num, s_name)

            if doc.Export(cad_folder_path, custom_filename, sheet_ids, dwg_options):
                cad_count += 1

    # 2. XỬ LÝ XUẤT PDF
    if export_pdf and matched_sheets:
        if not os.path.exists(pdf_folder_path):
            os.makedirs(pdf_folder_path)
            
        try:
            pdf_options = PDFExportOptions()
            pdf_options.Combine = combine_pdf
            
            selected_pdf_setup = pdf_setup_dict.get(selected_pdf_setup_name)
            if selected_pdf_setup:
                pdf_options = selected_pdf_setup.GetPDFExportOptions()
                pdf_options.Combine = combine_pdf

            if combine_pdf:
                pdf_options.FileName = pdf_name
                sheet_ids = System.Collections.Generic.List[ElementId]([s.Id for s in matched_sheets])
                doc.Export(pdf_folder_path, sheet_ids, pdf_options)
                pdf_count = len(matched_sheets)
            else:
                for sheet in matched_sheets:
                    sheet_ids = System.Collections.Generic.List[ElementId]([sheet.Id])
                    s_num = str(sheet.SheetNumber).replace("/", "-").replace("\\", "-")
                    s_name = str(sheet.Name).replace("/", "-").replace("\\", "-")
                    
                    pdf_options.FileName = "{}-{}-{}".format(pdf_name, s_num, s_name)
                    doc.Export(pdf_folder_path, sheet_ids, pdf_options)
                    pdf_count += 1
        except Exception as e:
            pass

    TransactionManager.Instance.TransactionTaskDone()

    OUT = "Hoàn tất! Đã xuất: {} file CAD và {} trang PDF.".format(cad_count, pdf_count)
else:
    OUT = "Đã hủy thao tác."
# ----------------------------------------
